% Simulink data dictionary motormodel_dd.sldd

Jmwg = Simulink.Parameter(8.45e-6, StorageClass="ExportedGlobal", DataType="double", Unit="[kgm2]")  % motor shaft + worm-gear moment of inertia
La = Simulink.Parameter(0.0011, StorageClass="ExportedGlobal", DataType="double", Unit="[Henry]")  % armature inductance

OmegaBKem = Simulink.Parameter([50 0.00021 0.01
 80 0.00018 0.013
 100 0.00016 0.018
 117.9267 0.000146 0.0272
 190.9821 0.000102 0.0221
 298.0481 4.9e-5 0.0184
 353.0482 4.3e-05 0.0183
 411.7613 3.7e-5 0.0181
 468.9535 3.3e-05 0.018
 526.6099 3e-05 0.0179
 588.5019 2.7e-5 0.0177
 644.5347 2.5e-05 0.0177
 706.042 2.2e-5 0.0176
 765.8641 2.1e-5 0.0175
 823.9169 1.9e-05 0.0175
 865.1538 1.9e-05 0.0178], StorageClass="ExportedGlobal", DataType="double", Unit="[radps,Nms,Vs]")  % omega, B, kem in table

Ra = Simulink.Parameter(0.65, StorageClass="ExportedGlobal", DataType="double", Unit="[Ohm]")  % armature resistance
TEnd = 10
TfSlipMot = Simulink.Parameter(0.025, StorageClass="ExportedGlobal", DataType="double", Unit="[Nm]")  % DC motor kinematic (slip) torque friction
TfStatMot = Simulink.Parameter(0.0001, StorageClass="ExportedGlobal", DataType="double", Unit="[Nm]")  % DC motor static torque friction
TsdS = 5.0e-5
xTorqueCases = Simulink.Parameter([-20; -15; -10; -5; 90; 100; 110; 145; 150; 155; 160], StorageClass="ExportedGlobal", DataType="double", Unit="[Nm]")  % ***

yTorqueCases = Simulink.Parameter([0.24 0.2 0.2
 0.02 0.1 0.1
 0.02 0.04 0.02
 0.02 0.02 0.02
 0.02 0.02 0
 0.02 0.08 0.08
 0.02 0.02 0.02
 0.02 0.02 0.02
 0.02 0.04 0.04
 0.02 0.1 0.1
 0.24 0.2 0.2], StorageClass="ExportedGlobal", DataType="double", Unit="[deg]")  % ***